# Grasshopper definition laser_vent.gh (Grasshopper 1.0.8)
# plug-ins: RhinoCodePluginGH

# ---- group: Parametric Inputs
# Details: Measurements in mm and degrees
# 
# Internal diameter used for eave aperture
# 
# Later parts of the duct have import outer diameters
_2nd_duct_outside_diameter = Panel("76.0")
_3rd_duct_outside_diameter = Panel("73.0")
duct_angle_1 = Slider(55, range=0..60)
negative = Negative(Value=duct_angle_1)
duct_start_internal_diameter = Panel("53.0")
distance_to_2nd_duct_section = Panel(Slider(40, range=10..80))
anchor_wall_corner_radius = Panel("10.0")
up_angle_degrees = Panel(negative)
duct_wall_t = Panel("1.5")
multiplication = Multiplication(A=duct_wall_t, B="2")
multiplication_2 = Multiplication(A=duct_wall_t, B="2")
subtraction = Subtraction(A=_2nd_duct_outside_diameter, B=multiplication_2)
subtraction_2 = Subtraction(A=_3rd_duct_outside_diameter, B=multiplication)
anchor_wall_t = Panel(Slider(3.2, range=0.5..5))
_2nd_duct_internal_diameter = Panel(subtraction)
_3rd_duct_internal_diameter = Panel(subtraction_2)
screw_hole_diameter = Panel("4.0")
# Angled Eave Duct For Laser Cutter
# Overview: Objectives to demonstrate here
# 
# - Fully parametric input with algorithmic part generation. Resulting parts should be properly generated over the full range of reasonable inputs. (This is subjective, of course)
# 
# - Python and C# code are used where appropriate to simplify steps that would reequire an unreasonable number of Grasshopper components
# 
# - The final part is built over logical steps that clearly flow from one to another. The reasoning of the algorithm should be easy to parse either for another person or myself when returning much later.
# 
# - The key measurements of the final part should be easily viewed to ensure that the part meets the intended requirements before fabricating the part.
# 
# - A number of challenges are called out for future improvements. The current state of this achieved the goals I needed, but there are a few fun challenges that would really improve the part [unnecessarily].
origin = XYPlane(Origin=Point(0, 0, 0))
radius_from_d = Number(expr("x/2", _2nd_duct_internal_diameter))
radius_from_d_2 = Number(expr("x/2", _3rd_duct_internal_diameter))
radius_from_d_3 = Number(expr("x/2", duct_start_internal_diameter))

# ----
# 0 Duct Base
stage_start_pt = Point(origin)
circle = Circle(Plane=stage_start_pt, Radius=radius_from_d_3)

# ---- group: 1 Wall exit hole
# 1 Wall Exit Hole
stage_start_pt_2 = Point(stage_start_pt)
# Challenge For The Future - Interpolate and Curve This Transition
unit_z = UnitZ(Factor=anchor_wall_t)
move = Move(Geometry=stage_start_pt_2, Motion=unit_z)  # -> Geometry, Transform
circle_2 = Circle(Plane=move.Geometry, Radius=radius_from_d_3)

# ----
# 2 First Angled Transition
yz_plane = YZPlane(Origin=Point(0, 0, 0))
unit_z_2 = UnitZ(Factor=1)
stage_start_pt_3 = Point(move.Geometry)
rotate = Rotate(Vector=unit_z_2, Axis=yz_plane, Angle=degrees(up_angle_degrees))
line_sdl = LineSDL(Start=stage_start_pt_3, Direction=rotate, Length=distance_to_2nd_duct_section)
end_points = EndPoints(Curve=line_sdl)  # -> Start, End
perp_frame = PerpFrame(Curve=line_sdl, Parameter=Slider(1, range=0..1))
circle_3 = Circle(Plane=end_points.End, Radius=radius_from_d)

# ----
# 3 Duct End
stage_start_pt_4 = Point(end_points.End)
unit_z_3 = UnitZ(Factor=1)
line_sdl_2 = LineSDL(Start=stage_start_pt_4, Direction=unit_z_3, Length=distance_to_2nd_duct_section)
end_points_2 = EndPoints(Curve=line_sdl_2)  # -> Start, End
perp_frame_2 = PerpFrame(Curve=line_sdl_2, Parameter=Slider(1, range=0..1))
circle_4 = Circle(Plane=end_points_2.End, Radius=radius_from_d_2)

# ----
# Solidify The Duct
merge_duct_sections = Merge(Data1=circle, Data2=circle_2, Data3=circle_3, Data4=circle_4)  # -> flatten(Result)
loft_type = Slider(3, range=0..5)
loft_options = LoftOptions(Closed=False, Adjust=False, Rebuild=0, Refit=0, Type=loft_type)
negative_2 = Negative(Value=duct_wall_t)
loft = Loft(Curves=merge_duct_sections, Options=loft_options)
brep_thicken_cl = BrepThickenCL(B=loft, D=negative_2)
thickened_duct_brep = Brep(brep_thicken_cl)
panel = Panel(thickened_duct_brep)
inner_duct_wall = Brep(loft)

# ----
# Create Anchor Wall
thickened_duct_brep_2 = Brep(thickened_duct_brep)
bounding_box = BoundingBox(Content=thickened_duct_brep_2, Plane=PlaneXY(0, 0, 0), UnionBox=True)  # -> Box, Box_2
scale_nu = ScaleNU(Geometry=bounding_box.Box, Plane=stage_start_pt, ScaleX=Slider(1.2, range=0..2), ScaleY=1, ScaleZ=1)  # -> Geometry, Transform
box_bottom_rect = BoxBottomRect(object=scale_nu.Geometry)
rect_corner_holes = RectCornerHoles(rectangle=box_bottom_rect, corner_radius=anchor_wall_corner_radius, hole_diameter=screw_hole_diameter)
rounded_rect_py = Python3Script(rect=box_bottom_rect, radius=anchor_wall_corner_radius)  # -> out, roundedRect; inputs rect: Rectangle3d, radius: Double
# ---------- rounded_rect_py: Python ----------
import Rhino.Geometry
import rhinoscriptsyntax as rs
#Remember to set input types
#Inspired by this post: https://discourse.mcneel.com/t/how-to-rounded-rectangle/182042/4

roundedRect = Rhino.Geometry.Curve.CreateFilletCornersCurve(rect.ToNurbsCurve(), radius, 0.1, 0.1)
# ---------- end rounded_rect_py ----------
merge = Merge(Data1=rect_corner_holes, Data2=circle)  # -> flatten(Result)
boundary_surfaces = BoundarySurfaces(Edges=rounded_rect_py.roundedRect, UseTasks=False)
panel_2 = Panel(rounded_rect_py.roundedRect)
unit_z_4 = UnitZ(Factor=anchor_wall_t)
make_holes_in_srfc_py = Python3Script(srfc=boundary_surfaces, curves=merge)  # -> out, holedSrfc; inputs srfc: Brep, curves: list of Curve
# ---------- make_holes_in_srfc_py: Python ----------
import Rhino
import System
from System.Collections.Generic import IEnumerable
from Rhino.Geometry import Brep 

tol = 0.1
currentSrfc: Brep = srfc
print(f"Cutters len={len(curves)} srfcType={type(srfc)}")

for i, crv in enumerate(curves):
    print(f"{i}: {type(crv)}")
    #See Python overloads: https://developer.rhino3d.com/guides/rhinopython/python-overloads/
    #See Brep.Split: https://developer.rhino3d.com/api/rhinocommon/rhino.geometry.brep/split
    splitSrfcs = currentSrfc.Split.Overloads[IEnumerable[Rhino.Geometry.Curve], System.Double]([crv], tol) 
    print(f"split len={len(splitSrfcs)}")
    if len(splitSrfcs) == 1:
        currentSrfc = splitSrfcs[0]
    else:

        if len(splitSrfcs) != 2:
            raise Exception("A split did not yield two surfaces")

        #see GetArea: https://developer.rhino3d.com/api/rhinocommon/rhino.geometry.brep/getarea
        currentSrfc = splitSrfcs[0] if splitSrfcs[0].GetArea(tol, tol) > splitSrfcs[1].GetArea(tol, tol) else splitSrfcs[1]

holedSrfc = currentSrfc
# ---------- end make_holes_in_srfc_py ----------
panel_3 = Panel(make_holes_in_srfc_py.out)
extrude = Extrude(Base=make_holes_in_srfc_py.holedSrfc, Direction=unit_z_4)

# ---- group: Duct Support
# Create Duct Support
original_duct_hole = Curve(circle)
anchor_wall = Brep(extrude)
inner_duct_wall_2 = Brep(inner_duct_wall)
duct_wall_t_2 = Number(duct_wall_t)
volume = Volume(Geometry=anchor_wall)  # -> Volume, Centroid
unit_z_5 = UnitZ(Factor=1)
unit_z_6 = UnitZ(Factor=1)
deconstruct = Deconstruct(Point=volume.Centroid)  # -> XComponent, YComponent, ZComponent
construct_point = ConstructPoint(XCoordinate=deconstruct.XComponent, YCoordinate="300", ZCoordinate="300")
multiplication_3 = Multiplication(A=duct_wall_t_2, B="-0.5")
brep_closest_point = BrepClosestPoint(Point=construct_point, Brep=anchor_wall)  # -> Point, Normal, Distance
curve_closest_point = CurveClosestPoint(Point=brep_closest_point.Point, Curve=original_duct_hole)  # -> Point, Parameter, Distance
deconstruct_2 = Deconstruct(Point=curve_closest_point.Point)  # -> XComponent, YComponent, ZComponent
construct_point_2 = ConstructPoint(XCoordinate=deconstruct_2.XComponent, YCoordinate=deconstruct_2.YComponent, ZCoordinate="50")
brep_closest_point_2 = BrepClosestPoint(Point=construct_point_2, Brep=anchor_wall)  # -> Point, Normal, Distance
unit_x = UnitX(Factor=multiplication_3)
unit_x_2 = UnitX(Factor=duct_wall_t_2)
line = Line(StartPoint=brep_closest_point.Point, EndPoint=brep_closest_point_2.Point)
curve_middle = CurveMiddle(Curve=line)
scale = Scale(Geometry=line, Center=curve_middle, Factor="0.9")  # -> Geometry, Transform
end_points_3 = EndPoints(Curve=scale.Geometry)  # -> Start, End
project_point = ProjectPoint(Point=end_points_3.Start, Direction=unit_z_5, Geometry=inner_duct_wall_2)  # -> Point, Index
project_point_2 = ProjectPoint(Point=end_points_3.End, Direction=unit_z_6, Geometry=inner_duct_wall_2)  # -> Point, Index
_4point_surface = _4PointSurface(CornerA=end_points_3.Start, CornerB=end_points_3.End, CornerC=project_point_2.Point, CornerD=project_point.Point)
extrude_2 = Extrude(Base=_4point_surface, Direction=unit_x_2)
move_2 = Move(Geometry=extrude_2, Motion=unit_x)  # -> Geometry, Transform
duct_support = Brep(move_2.Geometry)

# ----
# Join The Solid Result
duct_support_2 = Brep(duct_support)
merge_2 = Merge(Data1=thickened_duct_brep, Data2=extrude, Data3=duct_support_2)  # -> flatten(Result)

# ----
# Verify Important Measurements
highest_angled_point = Point(end_points.End)
lowest_angled_point = Point(move.Geometry)
thickened_duct_brep_3 = Brep(thickened_duct_brep)
deconstruct_rectangle = DeconstructRectangle(Rectangle=box_bottom_rect)  # -> BasePlane, XInterval, YInterval
deconstruct_3 = Deconstruct(Point=highest_angled_point)  # -> XComponent, YComponent, ZComponent
deconstruct_4 = Deconstruct(Point=lowest_angled_point)  # -> XComponent, YComponent, ZComponent
distance = Distance(domain=deconstruct_rectangle.XInterval)
distance_2 = Distance(domain=deconstruct_rectangle.YInterval)
construct_point_3 = ConstructPoint(XCoordinate=deconstruct_3.XComponent, YCoordinate="-300", ZCoordinate=deconstruct_4.ZComponent)
unit_y = UnitY(Factor=1)
construct_point_4 = ConstructPoint(XCoordinate=deconstruct_3.XComponent, YCoordinate="-300", ZCoordinate=deconstruct_3.ZComponent)
x_dimension = Panel(distance)
y_dimension = Panel(distance_2)
project_point_3 = ProjectPoint(Point=construct_point_3, Direction=unit_y, Geometry=thickened_duct_brep_3)  # -> Point, Index
project_point_4 = ProjectPoint(Point=construct_point_4, Direction=unit_y, Geometry=thickened_duct_brep_3)  # -> Point, Index
unit_z_7 = UnitZ(Factor=1)
vector_2pt = Vector2Pt(PointA=project_point_3.Point, PointB=project_point_4.Point, Unitize=False)  # -> Vector, Length
angle = Angle(VectorA=unit_z_7, VectorB=vector_2pt.Vector)  # -> Angle, Reflex
degrees = Degrees(Radians=angle.Angle)
angle_of_duct_transition = Panel(degrees)

# ---- group: Final Part To Bake And Export
solid_union = SolidUnion(Breps=merge_2)

# ----
# Challenge For The Future - Fillet The Edges
# https://discourse.mcneel.com/t/fillet-all-filletable-edges-of-a-brep-using-fillet-edge/150539/9
mesh_brep = MeshBrep(
    Brep=merge_2,
    Settings={GridMaxCount=0, GridMinCount=16, JaggedSeams=False, MaxEdgeLength=0, MinEdgeLength=0.0001, MinTolerance=0, Refine=True, RefineAngle=0, RelativeTolerance=0.65, SimplePlanes=True, Tolerance=0})  # disabled
mesh_union = MeshUnion(Meshes=mesh_brep)
face_boundaries = FaceBoundaries(Mesh=mesh_union)
boundary_surfaces_2 = BoundarySurfaces(Edges=face_boundaries)
brep_join = BrepJoin(Breps=boundary_surfaces_2)  # -> Breps, Closed
tolerance_in_degrees = Slider(0.201, range=0..5)
fillet_radius = Slider(0.124, range=0.01..0.5)
fillet_breps_dp = FilletBrepsDP(brep=thickened_duct_brep, brep_2=extrude, panel="5.0")  # disabled
python_3_script = Python3Script(srfc0=thickened_duct_brep, srfc1=extrude)  # -> out, filletSrfc; inputs srfc0: Surface, srfc1: Surface; disabled
# ---------- python_3_script: Python ----------
from Rhino.Geometry import Brep

# results = Surface.CreateRollingBallFillet(srfc0, srfc1, 10.0, 0.1)

results = Brep.CreateFilletEdges()

print(f"{results=}")

filletSrfc = results
# ---------- end python_3_script ----------
panel_4 = Panel(fillet_breps_dp)
panel_5 = Panel(python_3_script.out)

# ---- group: Test Geometry
brep = Brep(brep_join.Breps)

# ---- group: Convex Edges component but with a tolerance input
cluster = Cluster(brep=brep, degrees=tolerance_in_degrees)  # -> concaveindex, convexindex, mixedindex

# ---- group: Display Edges That Will Be Filleted
debrep = DeconstructBrep(Brep=brep)  # -> Faces, Edges, Vertices
item = ListItem(List=debrep.Edges, Index=[cluster.concaveindex, cluster.convexindex, cluster.mixedindex], Wrap=True)
crv = Curve(item)
preview = CustomPreview(Geometry=crv, Material=ColourSwatch(SwatchColor=RGB(255, 217, 0)))

# ----
filedge = FilletEdge(
    Shape=graft(brep),
    Blend=0,
    Metric=0,
    Edges=[cluster.concaveindex, cluster.convexindex, cluster.mixedindex],
    Radii=fillet_radius)

# ---- group: Move Test Geometry Right 2x Width and Display
bbox = BoundingBox(Content=filedge, Plane=PlaneXY(0, 0, 0))  # -> Box, Box_2
debrep_2 = DeconstructBrep(Brep=bbox.Box)  # -> Faces, Edges, Vertices
item_2 = ListItem(List=debrep_2.Edges, Index=0, Wrap=True)
len = Length(Curve=item_2)
multiplication_4 = Multiplication(A=len, B="2")
X = UnitX(Factor=multiplication_4)
move_3 = Move(Geometry=filedge, Motion=X)  # -> Geometry, Transform
preview_2 = CustomPreview(Geometry=move_3.Geometry, Material=ColourSwatch(SwatchColor=RGB(0, 127, 255)))

# ==== cluster BrepThickenCL
B = ClusterInput()
# JG 12/9/24
# Brep thicken technque from
# https://discourse.mcneel.com/t/brep-thicken/70126/2
D = ClusterInput()
join = BrepJoin(Breps=flatten(B))  # -> Breps, Closed
mesh = MeshBrep(
    Brep=join.Breps,
    Settings={GridMaxCount=0, GridMinCount=16, JaggedSeams=False, MaxEdgeLength=0, MinEdgeLength=0.0001, MinTolerance=0, Refine=True, RefineAngle=0, RelativeTolerance=0.65, SimplePlanes=True, Tolerance=0})
wbthicken = WeaverbirdsMeshThicken(MeshCurves=mesh, Distance=D, OffsetType=0)
explode = MeshExplode(Mesh=wbthicken, Interpolate=False)
demesh = DeconstructMesh(Mesh=explode)  # -> Vertices, Faces, Colours, Normals
lng = ListLength(List=demesh.Vertices)  # -> flatten(Length)
sift = SiftPattern(List=explode, SiftPattern=lng)  # -> Output0, Output1, Output2, Output3, Output4
demesh_2 = DeconstructMesh(Mesh=sift.Output3)  # -> Vertices, Faces, Colours, Normals
demesh_3 = DeconstructMesh(Mesh=sift.Output4)  # -> Vertices, Faces, Colours, Normals
deface = DeconstructFace(Face=demesh_2.Faces)  # -> CornerA, CornerB, CornerC, CornerD
deface_2 = DeconstructFace(Face=demesh_3.Faces)  # -> CornerA, CornerB, CornerC, CornerD
item = ListItem(List=demesh_3.Vertices, Index=deface_2.CornerA, Wrap=True)
item_2 = ListItem(List=demesh_2.Vertices, Index=deface.CornerA, Wrap=True)
item_3 = ListItem(List=demesh_2.Vertices, Index=deface.CornerB, Wrap=True)
item_4 = ListItem(List=demesh_2.Vertices, Index=deface.CornerC, Wrap=True)
item_5 = ListItem(List=demesh_3.Vertices, Index=deface_2.CornerB, Wrap=True)
item_6 = ListItem(List=demesh_3.Vertices, Index=deface_2.CornerC, Wrap=True)
item_7 = ListItem(List=demesh_3.Vertices, Index=deface_2.CornerD, Wrap=True)
srf4pt = _4PointSurface(CornerA=item_2, CornerB=item_3, CornerC=item_4)
srf4pt_2 = _4PointSurface(CornerA=item, CornerB=item_5, CornerC=item_6, CornerD=item_7)
join_2 = BrepJoin(Breps=flatten([srf4pt, srf4pt_2]))  # -> Breps, Closed
B_2 = ClusterOutput(join_2.Breps)

# ==== cluster BoxBottomRect
object = ClusterInput()
explode = ExplodeObject(Object=object, Recursive=False)
area = Area(Geometry=explode)  # -> Area, Centroid
pdecon = Deconstruct(Point=area.Centroid)  # -> XComponent, YComponent, ZComponent
sort = SortList(Keys=pdecon.ZComponent, ValuesA=explode)  # -> Keys, ValuesA
item = ListItem(List=sort.ValuesA, Index=0, Wrap=True)
rec = Rectangle(item)
rec_2 = ClusterOutput(rec)

# ==== cluster RectCornerHoles
rectangle = ClusterInput()
corner_radius = ClusterInput()
hole_diameter = ClusterInput()
rectangle_2 = Rectangle(rectangle)
corner_radius_2 = Number(corner_radius)
hole_diameter_2 = Number(hole_diameter)
explode = Explode(Curve=rectangle_2, Recursive=True)  # -> Segments, Vertices
area = Area(Geometry=rectangle_2)  # -> Area, Centroid
line = Line(StartPoint=area.Centroid, EndPoint=explode.Vertices)
point = Point(area.Centroid)
unit_vector = UnitVector(Vector=line)
end_points = EndPoints(Curve=line)  # -> Start, End
reverse = Reverse(Vector=unit_vector)
line_sdl = LineSDL(Start=end_points.End, Direction=reverse, Length=corner_radius_2)
end_points_2 = EndPoints(Curve=line_sdl)  # -> Start, End
circle = Circle(Plane=end_points_2.End, Radius=expr("x/2", hole_diameter_2))
circle_2 = ClusterOutput(circle)

# ==== cluster FilletBrepsDP
brep = ClusterInput()
brep_2 = ClusterInput()
panel = ClusterInput()
brep_3 = Brep(brep)
brep_4 = Brep(brep_2)
panel_2 = Panel(panel)
deconstruct_brep = DeconstructBrep(Brep=brep_4)  # -> Faces, Edges, Vertices; disabled
merge = Merge(Data1=brep_3, Data2=brep_4)  # -> flatten(Result)
solid_union = SolidUnion(Breps=merge)
area = Area(Geometry=deconstruct_brep.Faces)  # -> Area, Centroid; disabled
face_normals = FaceNormals(Mesh=deconstruct_brep.Faces)  # -> Centers, Normals; disabled
# JG - 12/9/24
# 
# From Daniel Piker Example:
# 
# https://discourse.mcneel.com/t/how-to-fillet-edges-of-solid-union-intersections/184447/2?u=jonathan_garrison
brep_5 = Brep(solid_union)
line_sdl = LineSDL(Start=face_normals.Centers, Direction=face_normals.Normals, Length=1)  # disabled
deconstruct_brep_2 = DeconstructBrep(Brep=brep_5)  # -> Faces, Edges, Vertices
deconstruct_brep_3 = DeconstructBrep(Brep=merge)  # -> Faces, flatten(Edges), Vertices
curve_middle = CurveMiddle(Curve=deconstruct_brep_2.Edges)
list_length = ListLength(List=deconstruct_brep_2.Edges)
curve_closest_point = CurveClosestPoint(Point=graft(curve_middle), Curve=deconstruct_brep_3.Edges)  # -> Point, Parameter, Distance
edge_curves = Curve(deconstruct_brep_2.Edges)
series = Series(Start=0, Step=1, Count=list_length)
sort_list = SortList(Keys=curve_closest_point.Distance)  # -> Keys, ValuesValuesA
list_item = ListItem(List=sort_list.Keys, Index=0, Wrap=True)
larger_than = LargerThan(FirstNumber=list_item, SecondNumber=0.01)  # -> LargerThan, OrEqualTo
cull_pattern = CullPattern(List=series, CullPattern=flatten(larger_than.LargerThan))
list_item_2 = ListItem(List=edge_curves, Index=cull_pattern, Wrap=True)
panel_3 = Panel(cull_pattern)
fillet_edge = FilletEdge(Shape=brep_5, Blend=0, Metric=0, Edges=cull_pattern, Radii=panel)
python_3_script = Python3Script(brep=brep_5, iEdges=cull_pattern, radius=panel)  # -> out, result; inputs brep: Brep, iEdges: list of Int32, radius: Double
# ---------- python_3_script: Python ----------
from Rhino.Geometry import Brep
import System

# public static Brep[] CreateFilletEdges(
#     Brep brep,
#     IEnumerable<int> edgeIndices,
#     IEnumerable<double> startRadii,
#     IEnumerable<double> endRadii,
#     BlendType blendType,
#     RailType railType,
#     double tolerance
# )

radiis = System.Array[float]([radius for i in range(len(iEdges))])
print(f"raddiis type={type(radiis)} len={len(radiis)} edgeCount={len(iEdges)}")

result = Brep.CreateFilletEdges(brep, iEdges, radiis, 1, 1, 0.1)
# ---------- end python_3_script ----------
result = ClusterOutput(fillet_edge)

# ==== cluster Cluster
degrees = ClusterInput()
brep = ClusterInput()
radians = Radians(Degrees=degrees)
c_script = CSharpScript(brep=brep, angleTolRad=radians)  # -> out, ConcaveIndex, ConvexIndex, MixedIndex; inputs brep: Brep, angleTolRad: Double
# ---------- c_script: C# ----------
using System;
using System.Collections;
using System.Collections.Generic;

using Rhino;
using Rhino.Geometry;

using Grasshopper;
using Grasshopper.Kernel;
using Grasshopper.Kernel.Data;
using Grasshopper.Kernel.Types;

public class Script_Instance : GH_ScriptInstance
{
   private void Print(string text) { /* Implementation hidden. */ }
//   private void Print(string format, params object[] args) { /* Implementation hidden. */ }
//   private void Reflect(object obj) { /* Implementation hidden. */ }
//   private void Reflect(object obj, string method_name) { /* Implementation hidden. */ }

//   private readonly RhinoDoc RhinoDocument;
//   private readonly GH_Document GrasshopperDocument;
//   private readonly IGH_Component Component;
  /// <summary>
  /// Gets the current iteration count. The first call to RunScript() is associated with Iteration==0.
  /// Any subsequent call within the same solution will increment the Iteration count.
  /// </summary>
  private readonly int Iteration;

  private void RunScript(
	Brep brep,
	double angleTolRad,
	ref object ConcaveIndex,
	ref object ConvexIndex,
	ref object MixedIndex)
  {
    Print("RunScript running");
    if (brep != null)
    {
      Print("RunScript brep!=null edges:" + brep.Edges.Count);

      List<int> list = new List<int>();
      List<int> list2 = new List<int>();
      List<int> list3 = new List<int>();

      for (int i = 0; i < brep.Edges.Count; i++)
      {
        BrepEdge edge = brep.Edges[i];
        bool convex = false;
        bool concave = false;

        EdgeConcavity(edge, angleTolRad, ref convex, ref concave);
        if (convex && concave)
        {
          list3.Add(i);
        }
        else if (convex)
        {
          list.Add(i);
        }
        else if (concave)
        {
          list2.Add(i);
        }
      }

      ConvexIndex = list;
      ConcaveIndex = list2;
      MixedIndex = list3;

      Print("RunScript end. ConvexIndex:" + list.Count + " ConcaveIndex:" + list2.Count + " MixedIndex=" + list3.Count);
    }
  }

  private void EdgeConcavity(BrepEdge edge, double tolrad, ref bool convex, ref bool concave)
  {
    Print("EdgeConcavity");
    convex = false;
    concave = false;
    int[] array = edge.AdjacentFaces();
    Print("EdgeConcavity adjFaces:" + array.Length);
    if (array.Length != 2)
    {
      return;
    }
    int num = edge.SpanCount * edge.Degree * 5;
    double min = edge.Domain.Min;
    double max = edge.Domain.Max;
    Print("edge num:" + num + " min:" + min + " max:" + max);
    for (int i = 0; i <= num; i++)
    {
      double num2 = i / num;
      num2 = min + num2 * (max - min);
      switch (edge.ConcavityAt(num2, tolrad))
      {
        case Concavity.Concave:
          concave = true;
          break;
        case Concavity.Convex:
          convex = true;
          break;
      }
    }
  }
}
# ---------- end c_script ----------
c_script_2 = CSharpScript(brep=brep, angleTolRad=radians)  # -> out, ConcaveIndex, ConvexIndex, MixedIndex; inputs brep: Brep, angleTolRad: Double; disabled
# ---------- c_script_2: C# ----------
    if (brep != null)
    {

      List<int> list = new List<int>();
      List<int> list2 = new List<int>();
      List<int> list3 = new List<int>();

      for (int i = 0; i < brep.Edges.Count; i++)
      {
        BrepEdge edge = brep.Edges[i];
        bool convex = false;
        bool concave = false;

        EdgeConcavity(edge, angleTolRad, out convex, out  concave);
        if (convex && concave)
        {
          list3.Add(i);
        }
        else if (convex)
        {
          list.Add(i);
        }
        else if (concave)
        {
          list2.Add(i);
        }
      }

      ConvexIndex = list;
      ConcaveIndex = list2;
      MixedIndex = list3;
    }
# ---------- c_script_2: C# additional code ----------
  private static void EdgeConcavity(BrepEdge edge, double tolrad, out bool convex, out bool concave)
  {
    convex = false;
    concave = false;
    int[] array = edge.AdjacentFaces();
    if (array.Length != 2)
    {
      return;
    }
    int num = edge.SpanCount * edge.Degree * 5;
    double min = edge.Domain.Min;
    double max = edge.Domain.Max;
    for (int i = 0; i <= num; i++)
    {
      double num2 = i / num;
      num2 = min + num2 * (max - min);
      switch (edge.ConcavityAt(num2, tolrad))
      {
        case Concavity.Concave:
          concave = true;
          break;
        case Concavity.Convex:
          convex = true;
          break;
      }
    }
  }
# ---------- end c_script_2 ----------
c_script_3 = CSharpScript()  # -> out, a
# ---------- c_script_3: C# ----------
using System;
using System.Linq;
using System.Collections;
using System.Collections.Generic;
using System.Drawing;

using Rhino;
using Rhino.Geometry;

using Grasshopper;
using Grasshopper.Kernel;
using Grasshopper.Kernel.Data;
using Grasshopper.Kernel.Types;

public class Script_Instance : GH_ScriptInstance
{

    private void RunScript(object x, object y, ref object a)
    {
        // Write your logic here
        a = null;
    }
}
# ---------- end c_script_3 ----------
panel = Panel(c_script.out)
mixedindex = ClusterOutput(c_script.MixedIndex)
convexindex = ClusterOutput(c_script.ConvexIndex)
concaveindex = ClusterOutput(c_script.ConcaveIndex)

# ==== cluster Distance
domain = ClusterInput()
deconstruct_domain = DeconstructDomain(Domain=domain)  # -> Start, End
subtraction = Subtraction(A=deconstruct_domain.End, B=deconstruct_domain.Start)
result = ClusterOutput(subtraction)
