# Grasshopper definition ConvexEdgesTol Fillet All Edges.gh (Grasshopper 1.0.8)

tolerance_in_degrees = Slider(0.201, range=0..5)
fillet_radius = Slider(0.124, range=0.01..0.5)

# ---- group: Test Geometry
brep = Brep([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])

# ---- group: Convex Edges component but with a tolerance input
cluster = Cluster(brep=brep, degrees=tolerance_in_degrees)  # -> concaveindex, convexindex, mixedindex

# ---- group: Display Edges That Will Be Filleted
# https://discourse.mcneel.com/t/fillet-all-filletable-edges-of-a-brep-using-fillet-edge/150539/9
debrep = DeconstructBrep(Brep=brep)  # -> Faces, Edges, Vertices
item = ListItem(List=debrep.Edges, Index=[cluster.concaveindex, cluster.convexindex, cluster.mixedindex], Wrap=True)
crv = Curve(item)
preview = CustomPreview(Geometry=crv, Material=ColourSwatch(SwatchColor=RGB(255, 217, 0)))

# ----
filedge = FilletEdge(
    Shape=graft(brep),
    Blend=0,
    Metric=0,
    Edges=[cluster.concaveindex, cluster.convexindex, cluster.mixedindex],
    Radii=fillet_radius)

# ---- group: Move Test Geometry Right 2x Width and Display
bbox = BoundingBox(Content=filedge, Plane=PlaneXY(0, 0, 0))  # -> Box, Box_2
debrep_2 = DeconstructBrep(Brep=bbox.Box)  # -> Faces, Edges, Vertices
item_2 = ListItem(List=debrep_2.Edges, Index=0, Wrap=True)
len = Length(Curve=item_2)
multiplication = Multiplication(A=len, B="2")
X = UnitX(Factor=multiplication)
move = Move(Geometry=filedge, Motion=X)  # -> Geometry, Transform
preview_2 = CustomPreview(Geometry=move.Geometry, Material=ColourSwatch(SwatchColor=RGB(0, 127, 255)))

# ==== cluster Cluster
degrees = ClusterInput()
radians = Radians(Degrees=degrees)
brep = ClusterInput()
c_script = CSharpScript(brep=brep, angleTolRad=radians)  # -> ConcaveIndex, ConvexIndex, MixedIndex; inputs brep: Brep, angleTolRad: Double
# ---------- c_script: C# ----------
    if (brep != null)
    {

      List<int> list = new List<int>();
      List<int> list2 = new List<int>();
      List<int> list3 = new List<int>();

      for (int i = 0; i < brep.Edges.Count; i++)
      {
        BrepEdge edge = brep.Edges[i];
        bool convex = false;
        bool concave = false;

        EdgeConcavity(edge, angleTolRad, out convex, out  concave);
        if (convex && concave)
        {
          list3.Add(i);
        }
        else if (convex)
        {
          list.Add(i);
        }
        else if (concave)
        {
          list2.Add(i);
        }
      }

      ConvexIndex = list;
      ConcaveIndex = list2;
      MixedIndex = list3;
    }
# ---------- c_script: C# additional code ----------
  private static void EdgeConcavity(BrepEdge edge, double tolrad, out bool convex, out bool concave)
  {
    convex = false;
    concave = false;
    int[] array = edge.AdjacentFaces();
    if (array.Length != 2)
    {
      return;
    }
    int num = edge.SpanCount * edge.Degree * 5;
    double min = edge.Domain.Min;
    double max = edge.Domain.Max;
    for (int i = 0; i <= num; i++)
    {
      double num2 = i / num;
      num2 = min + num2 * (max - min);
      switch (edge.ConcavityAt(num2, tolrad))
      {
        case Concavity.Concave:
          concave = true;
          break;
        case Concavity.Convex:
          convex = true;
          break;
      }
    }
  }
# ---------- end c_script ----------
concaveindex = ClusterOutput(c_script.ConcaveIndex)
convexindex = ClusterOutput(c_script.ConvexIndex)
mixedindex = ClusterOutput(c_script.MixedIndex)
