# Grasshopper definition DanielPiker_filletintersection.gh (Grasshopper 1.0.8)

cyl = Cylinder(Base=PlaneXY(0, 0, 0), Radius=1, Length=10)
xz = XZPlane(Origin=Point(0, 0, 5))
cap = CapHoles(Brep=cyl)
rotate = Rotate(Geometry=cap, Angle=1.570796327, Plane=xz)  # -> Geometry, Transform
move = Move(Geometry=rotate.Geometry, Motion=Vector(-0.1094503107, 0.7137795774, 0))  # -> Geometry, Transform
fillet_breps_dp = FilletBrepsDP(brep=cap, brep_2=move.Geometry, R=Slider(1, range=0..1))
brep = Brep(fillet_breps_dp)

# ==== cluster FilletBrepsDP
brep = ClusterInput()
brep_2 = ClusterInput()
brep_3 = Brep(brep)
brep_4 = Brep(brep_2)
# JG - 12/9/24
# 
# From Daniel Piker Example:
# 
# https://discourse.mcneel.com/t/how-to-fillet-edges-of-solid-union-intersections/184447/2?u=jonathan_garrison
sunion = SolidUnion(Breps=[brep_4, brep_3])
brep_5 = Brep(sunion)
debrep = DeconstructBrep(Brep=[brep_3, brep_4])  # -> Faces, flatten(Edges), Vertices
debrep_2 = DeconstructBrep(Brep=brep_5)  # -> Faces, Edges, Vertices
midpt = CurveMiddle(Curve=debrep_2.Edges)
lng = ListLength(List=debrep_2.Edges)
crv_cp = CurveClosestPoint(Point=graft(midpt), Curve=debrep.Edges)  # -> Point, Parameter, Distance
series = Series(Start=0, Step=1, Count=lng)
sort = SortList(Keys=crv_cp.Distance)  # -> Keys, ValuesA
item = ListItem(List=sort.Keys, Index=0, Wrap=True)
larger = LargerThan(FirstNumber=item, SecondNumber=0.01)  # -> LargerThan, OrEqualTo
cull = CullPattern(List=series, CullPattern=flatten(larger.LargerThan))
R = ClusterInput()
filedge = FilletEdge(Shape=brep_5, Blend=0, Metric=0, Edges=cull, Radii=R)
B = ClusterOutput(filedge)
