# Grasshopper definition brep_thickness_re.gh (Grasshopper 1.0.8)

brep = Brep([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])
brep_thicken = BrepThicken(B=brep, D=Slider(229.317, range=0..500))
brep_2 = Brep(brep_thicken)
panel = Panel(brep_2)

# ==== cluster BrepThicken
B = ClusterInput()
D = ClusterInput()
join = BrepJoin(Breps=flatten(B))  # -> Breps, Closed
smesh = SimpleMesh(Brep=join.Breps)
# JG 12/9/24
# Brep thicken technque from
# https://discourse.mcneel.com/t/brep-thicken/70126/2
wbthicken = WeaverbirdsMeshThicken(MeshCurves=smesh, Distance=D, OffsetType=0)
explode = MeshExplode(Mesh=wbthicken, Interpolate=False)
demesh = DeconstructMesh(Mesh=explode)  # -> Vertices, Faces, Colours, Normals
lng = ListLength(List=demesh.Vertices)  # -> flatten(Length)
sift = SiftPattern(List=explode, SiftPattern=lng)  # -> Output0, Output1, Output2, Output3, Output4
demesh_2 = DeconstructMesh(Mesh=sift.Output3)  # -> Vertices, Faces, Colours, Normals
demesh_3 = DeconstructMesh(Mesh=sift.Output4)  # -> Vertices, Faces, Colours, Normals
deface = DeconstructFace(Face=demesh_2.Faces)  # -> CornerA, CornerB, CornerC, CornerD
deface_2 = DeconstructFace(Face=demesh_3.Faces)  # -> CornerA, CornerB, CornerC, CornerD
item = ListItem(List=demesh_3.Vertices, Index=deface_2.CornerA, Wrap=True)
item_2 = ListItem(List=demesh_2.Vertices, Index=deface.CornerA, Wrap=True)
item_3 = ListItem(List=demesh_2.Vertices, Index=deface.CornerB, Wrap=True)
item_4 = ListItem(List=demesh_2.Vertices, Index=deface.CornerC, Wrap=True)
item_5 = ListItem(List=demesh_3.Vertices, Index=deface_2.CornerB, Wrap=True)
item_6 = ListItem(List=demesh_3.Vertices, Index=deface_2.CornerC, Wrap=True)
item_7 = ListItem(List=demesh_3.Vertices, Index=deface_2.CornerD, Wrap=True)
srf4pt = _4PointSurface(CornerA=item_2, CornerB=item_3, CornerC=item_4)
srf4pt_2 = _4PointSurface(CornerA=item, CornerB=item_5, CornerC=item_6, CornerD=item_7)
join_2 = BrepJoin(Breps=flatten([srf4pt, srf4pt_2]))  # -> Breps, Closed
B_2 = ClusterOutput(join_2.Breps)
